# Grasshopper definition Inner and Endwall Test.gh (Grasshopper 1.0.7)

spacing = Slider(300, range=0..2011)
grip_width = Slider(150, range=25..301)
grip_width_2 = Number(grip_width)
spacing_2 = Number(spacing)
spacing_3 = Number(spacing_2)
grip_width_3 = Number(grip_width_2)
min = Minimum(A=grip_width_3, B=spacing_3)

ply_thickness = Slider(18, range=0..100)
tool_size = Slider(12, range=0..20)
tolerance = Slider(0.25, range=0..5)
wall_thickness = Slider(200, range=0..500)
crv = Curve([<curve referenced from the Rhino model> x7])

# ---- group: Test Curves
test_curves_and_exclude_open_and_non_pla = TestCurvesAndExcludeOpenAndNonPlanar(crv=crv)  # "Test Curves and exclude open and non planar"

# ----
devide_curves = DevideCurves(curves=test_curves_and_exclude_open_and_non_pla, ply_thickness=ply_thickness, spacing=spacing_2)  # -> S, L, pl_2
cluster = Cluster_14(width_2=min, width="60", ply_thickness=ply_thickness, tool_size=tool_size, thickness=wall_thickness, tolarance=tolerance)  # -> crv_7, crv_6, crv_8, pln_4
cluster_2 = Cluster_15(O=cluster.crv_8, A=PlaneXY(0, 0, 0), B=devide_curves.pl_2)
cluster_3 = Cluster_15(O=cluster.crv_7, A=PlaneXY(0, 0, 0), B=devide_curves.pl_2)
cluster_4 = Cluster_15(O=cluster.crv_6, A=PlaneXY(0, 0, 0), B=devide_curves.pl_2)

cluster_5 = Cluster(geo=devide_curves.L, C=cluster_2)
geo = Geometry(cluster_3)
cluster_6 = Cluster(geo=devide_curves.S, C=cluster_4)
division = Division(A=wall_thickness, B=2)
trim = TrimTree(Tree=cluster_6, Depth=2)
trim_2 = TrimTree(Tree=cluster_5, Depth=1)
join = JoinCurves(Curves=trim_2, Preserve=False)  # -> simplify(Curves)
join_2 = JoinCurves(Curves=trim, Preserve=False)
boundary = BoundarySurfaces(Edges=join_2)
evalsrf = EvaluateSurface(Surface=reparameterize(boundary), Point=Point(0.5, 0.5, 0))  # -> Point, Normal, UDirection, VDirection, Frame
num = Number(division)
amp = Amplitude(Vector=evalsrf.Normal, Amplitude=num)
move = Move(Geometry=evalsrf.Frame, Motion=amp)  # -> Geometry, Transform
boundary_2 = BoundarySurfaces(Edges=geo)
geo_2 = Geometry(boundary)
cluster_7 = Cluster_2(T=join, T_2=move.Geometry)
mirror = Mirror(Geometry=geo_2, Plane=move.Geometry)  # -> Geometry, Transform
trim_3 = TrimTree(Tree=cluster_7, Depth=1)
geo_3 = Geometry([mirror.Geometry, geo_2])
boundary_3 = BoundarySurfaces(Edges=trim_3)  # -> graft(Surfaces)
geo_4 = Geometry(boundary_2)

flip = Flip(Surface=boundary_3)  # -> Surface, Result
ply_thickness_2 = Number(ply_thickness)

srf = Surface([geo_3, boundary_3, geo_4])
trim_4 = TrimTree(Tree=srf, Depth=1)

closed_solid_offset = ClosedSolidOffset(srf=geo_4, A=ply_thickness_2)
closed_solid_offset_2 = ClosedSolidOffset(srf=geo_3, A=ply_thickness_2)
closed_solid_offset_3 = ClosedSolidOffset(srf=flip.Surface, A=ply_thickness_2)

# ---- group: 2D
cluster_8 = Cluster_10(srf=trim_4)
cluster_9 = Cluster_9(srf=cluster_8)
cluster_10 = Cluster_8(geo=cluster_9)
cluster_11 = Cluster_7(srf=cluster_10)
cluster_12 = Cluster_6(srf=cluster_11)
geo_5 = Geometry(cluster_12)

# ----
geo_6 = Geometry([closed_solid_offset, closed_solid_offset_2, closed_solid_offset_3])

# ==== cluster Cluster
geo = ClusterInput()
C = ClusterInput()
cls = Closed(Curve=C)  # -> Closed, Periodic
not = GateNot(A=cls.Closed)
dispatch = Dispatch(List=C, DispatchPattern=not)  # -> ListA, ListB
geo_2 = Geometry(geo)
geo_3 = Geometry(dispatch.ListA)
end = EndPoints(Curve=geo_3)  # -> Start, End
geo_4 = Geometry(dispatch.ListB)
end_2 = EndPoints(Curve=geo_2)  # -> Start, End
weave = Weave(Pattern=[0, 1], Stream0=end.Start, Stream1=end.End, NullGaps=False)
merge = Merge(Data1=end_2.Start, Data2=end_2.End)
panel = Panel("""0
-1""")
ins = InsertItems(List=weave, Item=merge, Indices=panel, Wrap=True)
partition = PartitionList(List=ins, Size=2)
pline = PolyLine(Vertices=partition, Closed=False)
trim = TrimTree(Tree=pline, Depth=1)
match = MatchTree(Tree=trim, Guide=geo_3)
join = JoinCurves(Curves=[match, geo_3, geo_4], Preserve=False)
C_2 = ClusterOutput(join)

# ==== cluster Cluster_2
T = ClusterInput()
T_2 = ClusterInput()
trim = TrimTree(Tree=T, Depth=1)
trim_2 = TrimTree(Tree=T_2, Depth=1)
crv = Curve(trim)
cls = Closed(Curve=crv)  # -> Closed, Periodic
dispatch = Dispatch(List=crv, DispatchPattern=cls.Closed)  # -> ListA, ListB
mirror = Mirror(Geometry=dispatch.ListB, Plane=trim_2)  # -> graft(Geometry), Transform
merge = Merge(Data1=graft(dispatch.ListB), Data2=mirror.Geometry)
crv_2 = Curve(graft(dispatch.ListA))
end = EndPoints(Curve=merge)  # -> Start, End
pline = PolyLine(Vertices=end.Start, Closed=False)
pline_2 = PolyLine(Vertices=end.End, Closed=False)
merge_2 = Merge(Data1=crv_2, Data2=merge, Data3=pline, Data4=pline_2)
join = JoinCurves(Curves=merge_2, Preserve=False)
trim_3 = TrimTree(Tree=join, Depth=1)
T_3 = ClusterOutput(trim_3)

# ==== cluster DevideCurves
curves = ClusterInput()
ply_thickness = ClusterInput()
crv = Curve(graft(curves))
spacing = ClusterInput()
cluster = Cluster_5(num=ply_thickness, crv=crv)
crv_2 = Curve(cluster)
geo = Geometry(cluster)
crv_3 = Curve(crv)
explode = Explode(Curve=cluster, Recursive=True)  # -> graft(Segments), Vertices
cluster_2 = Cluster_5(num=ply_thickness, crv=crv_3)
cluster_3 = Cluster_3(crv=explode.Segments, num=spacing)  # -> P, T
cluster_4 = Cluster_4(crv=crv_2)
explode_2 = Explode(Curve=cluster_2, Recursive=True)  # -> Segments, Vertices
explode_3 = Explode(Curve=crv_3, Recursive=True)  # -> Segments, Vertices
cull_i = CullIndex(List=cluster_3.T, Indices=[0, -1], Wrap=True)
explode_4 = Explode(Curve=cluster_4, Recursive=True)  # -> graft(Segments), Vertices
eval = EvaluateCurve(Curve=reparameterize(explode_3.Segments), Parameter=1)  # -> Point, Tangent, Angle
cull_i_2 = CullIndex(List=cluster_3.P, Indices=[0, -1], Wrap=True)
shift = ShiftList(List=explode_3.Segments, Shift=1, Wrap=True)
end = EndPoints(Curve=explode_2.Segments)  # -> Start, End
crv_cp = CurveClosestPoint(Point=cull_i_2, Curve=explode_4.Segments)  # -> Point, Parameter, Distance
line = LineSDL(Start=end.End, Direction=eval.Tangent, Length=Slider(200, range=0..1000))
vec2pt = Vector2Pt(PointA=cull_i_2, PointB=crv_cp.Point, Unitize=False)  # -> Vector, Length
ccx = CurveCurve(CurveA=shift, CurveB=line)  # -> Points, ParamsA, ParamsB
neg = Negative(Value=vec2pt.Vector)
trim = TrimTree(Tree=ccx.Points, Depth=1)
explode_5 = Explode(Curve=geo, Recursive=True)  # -> simplify(graft(Segments)), Vertices
ln = Line(StartPoint=end.Start, EndPoint=trim)  # -> simplify(graft(Line))
pl = ConstructPlane(Origin=cull_i_2, XAxis=cull_i, YAxis=neg)  # -> simplify(Plane)
S = ClusterOutput(explode_5.Segments)
L = ClusterOutput(ln)
pl_2 = ClusterOutput(pl)

# ==== cluster Cluster_6
srf = ClusterInput()

# ---- group: Array relative to size
srf_2 = Surface(srf)
bbox = BoundingBox(Content=srf_2, Plane=PlaneXY(0, 0, 0))  # -> Box, Box_2
debox = DeconstructBox(Box=bbox.Box)  # -> Plane, X, Y, Z
dedomain = DeconstructDomain(Domain=debox.X)  # -> Start, End
dedomain_2 = DeconstructDomain(Domain=debox.Y)  # -> Start, End
subtraction = Subtraction(A=dedomain.End, B=dedomain.Start)
subtraction_2 = Subtraction(A=dedomain_2.End, B=dedomain_2.Start)
sort = SortList(Keys=subtraction_2)  # -> reverse(Keys), ValuesA
item = ListItem(List=sort.Keys, Index=0, Wrap=True)  # -> flatten(Item)
shift = ShiftList(List=subtraction, Shift=-1, Wrap=True)
shift_2 = ShiftList(List=item, Shift=-1, Wrap=True)
addition = Addition(A=shift, B="100")
addition_2 = Addition(A=shift_2, B="100")
replace = ReplaceItems(List=addition, Item=0, Indices=0, Wrap=False)
replace_2 = ReplaceItems(List=addition_2, Item=0, Indices=0, Wrap=False)
ma = MassAddition(Input=replace)  # -> Result, PartialResults
ma_2 = MassAddition(Input=replace_2)  # -> Result, graft(PartialResults)
trim = TrimTree(Tree=ma.PartialResults, Depth=1)
match = MatchTree(Tree=ma_2.PartialResults, Guide=trim)
X = UnitX(Factor=trim)
Y = UnitY(Factor=match)
addition_3 = Addition(A=X, B=Y)
move = Move(Geometry=srf_2, Motion=addition_3)  # -> simplify(Geometry), Transform

# ----
G = ClusterOutput(move.Geometry)

# ==== cluster Cluster_7
srf = ClusterInput()

# ---- group: Sort my size
srf_2 = Surface(srf)
area = Area(Geometry=srf_2)  # -> Area, Centroid
sort = SortList(Keys=area.Area, ValuesA=srf_2)  # -> Keys, reverse(ValuesA)
srf_3 = Surface(sort.ValuesA)

# ----
srf_4 = ClusterOutput(srf_3)

# ==== cluster Cluster_8
geo = ClusterInput()

# ---- group: Aligne with lower left corner
geo_2 = Geometry(geo)
bbox = BoundingBox(Content=geo_2, Plane=PlaneXY(0, 0, 0))  # -> Box, Box_2
box_corners = BoxCorners(Box=bbox.Box)  # -> CornerA, CornerB, CornerC, CornerD, CornerE, CornerF, CornerG, CornerH
pt = Point(Point(0, 0, 0))
vec2pt = Vector2Pt(PointA=box_corners.CornerA, PointB=pt, Unitize=False)  # -> Vector, Length
move = Move(Geometry=geo_2, Motion=vec2pt.Vector)  # -> Geometry, Transform

# ----
G = ClusterOutput(move.Geometry)

# ==== cluster Cluster_9
srf = ClusterInput()

# ---- group: Rotate
srf_2 = Surface(srf)
bbox = BoundingBox(Content=srf_2, Plane=PlaneXY(0, 0, 0))  # -> Box, Box_2
debox = DeconstructBox(Box=bbox.Box)  # -> Plane, X, Y, Z
smaller = SmallerThan(FirstNumber=debox.X, SecondNumber=debox.Y)  # -> SmallerThan, OrEqualTo
dispatch = Dispatch(List=srf_2, DispatchPattern=smaller.SmallerThan)  # -> ListA, ListB
rotate = Rotate(Geometry=dispatch.ListB, Angle=1.570796327, Plane=PlaneXY(0, 0, 0))  # -> Geometry, Transform
geo = Geometry([dispatch.ListA, rotate.Geometry])

# ----
geo_2 = ClusterOutput(geo)

# ==== cluster Cluster_10
srf = ClusterInput()

# ---- group: Orient flat
srf_2 = Surface(srf)
evalsrf = EvaluateSurface(Surface=reparameterize(srf_2), Point=Point(0.5, 0.5, 0))  # -> Point, Normal, UDirection, VDirection, Frame
orient = Orient(Geometry=srf_2, Source=evalsrf.Frame, Target=PlaneXY(0, 0, 0))  # -> Geometry, Transform
srf_3 = Surface(orient.Geometry)

# ----
srf_4 = ClusterOutput(srf_3)

# ==== cluster Cluster_14
ply_thickness = ClusterInput()
thickness = ClusterInput()
tolarance = ClusterInput()
tool_size = ClusterInput()
xy = XYPlane(Origin=Point(0, 0, 0))
width = ClusterInput()
width_2 = ClusterInput()
multiplication = Multiplication(A=tolarance, B=2)
multiplication_2 = Multiplication(A=tolarance, B=2)
addition = Addition(A=ply_thickness, B=multiplication_2)
addition_2 = Addition(A=width, B=multiplication)
cluster = Cluster_13(A=addition_2)
cluster_2 = Cluster_13(A=addition)
num = Number(width_2)
multiplication_3 = Multiplication(A=tolarance, B=2)

deplane = DeconstructPlane(Plane=xy)  # -> Origin, XAxis, YAxis, ZAxis
neg = Negative(Value=deplane.ZAxis)
addition_3 = Addition(A=num, B=tolarance)
division = Division(A=addition_3, B=2)
amp = Amplitude(Vector=neg, Amplitude=ply_thickness)
neg_2 = Negative(Value=division)
merge = Merge(Data1=division, Data2=neg_2)
X = UnitX(Factor=merge)
move = Move(Geometry=deplane.Origin, Motion=X)  # -> Geometry, Transform
move_2 = Move(Geometry=move.Geometry, Motion=amp)  # -> Geometry, Transform

number_slider = Slider(60, range=0..200)
subtraction = Subtraction(A=thickness, B=width, C=multiplication_3)

deplane_2 = DeconstructPlane(Plane=xy)  # -> Origin, XAxis, YAxis, ZAxis
division_2 = Division(A=num, B=2)
neg_3 = Negative(Value=division_2)
merge_2 = Merge(Data1=division_2, Data2=neg_3)
X_2 = UnitX(Factor=merge_2)
move_3 = Move(Geometry=deplane_2.Origin, Motion=X_2)  # -> Geometry, Transform

deplane_3 = DeconstructPlane(Plane=xy)  # -> Origin, XAxis, YAxis, ZAxis
neg_4 = Negative(Value=deplane_3.XAxis)
pl = ConstructPlane(Origin=deplane_3.Origin, XAxis=deplane_3.ZAxis, YAxis=neg_4)
pl_2 = ConstructPlane(Origin=deplane_3.Origin, XAxis=deplane_3.ZAxis, YAxis=deplane_3.XAxis)

multiplication_4 = Multiplication(A=tolarance, B=2)
deplane_4 = DeconstructPlane(Plane=xy)  # -> Origin, XAxis, YAxis, ZAxis
division_3 = Division(A=subtraction, B=2)
division_4 = Division(A=width, B=2)
addition_4 = Addition(A=width, B=multiplication_4)

deplane_5 = DeconstructPlane(Plane=xy)  # -> Origin, XAxis, YAxis, ZAxis
neg_5 = Negative(Value=deplane_5.YAxis)
amp_2 = Amplitude(Vector=neg_5, Amplitude=number_slider)
move_4 = Move(Geometry=deplane_5.Origin, Motion=amp_2)  # -> Geometry, Transform
pl_3 = ConstructPlane(Origin=move_4.Geometry, XAxis=deplane_5.YAxis, YAxis=deplane_5.XAxis)

subtraction_2 = Subtraction(A=number_slider, B=division_4)
addition_5 = Addition(A=tool_size, B=tolarance)

division_5 = Division(A=thickness, B=2)
deplane_6 = DeconstructPlane(Plane=xy)  # -> Origin, XAxis, YAxis, ZAxis
neg_6 = Negative(Value=deplane_6.ZAxis)
amp_3 = Amplitude(Vector=neg_6, Amplitude=division_5)
move_5 = Move(Geometry=deplane_6.Origin, Motion=amp_3)  # -> Geometry, Transform
pl_4 = ConstructPlane(Origin=move_5.Geometry, XAxis=neg_6, YAxis=deplane_6.XAxis)

neg_7 = Negative(Value=deplane_4.ZAxis)
neg_8 = Negative(Value=deplane_4.ZAxis)
neg_9 = Negative(Value=deplane_4.ZAxis)
division_6 = Division(A=addition_4, B=2)
amp_4 = Amplitude(Vector=deplane_4.ZAxis, Amplitude=ply_thickness)
amp_5 = Amplitude(Vector=deplane_4.YAxis, Amplitude=width)
amp_6 = Amplitude(Vector=deplane_4.YAxis, Amplitude=subtraction_2)
amp_7 = Amplitude(Vector=neg_7, Amplitude=division_3)
amp_8 = Amplitude(Vector=neg_9, Amplitude=division_6)
amp_9 = Amplitude(Vector=deplane_4.YAxis, Amplitude=ply_thickness)
amp_10 = Amplitude(Vector=neg_8, Amplitude=ply_thickness)
neg_10 = Negative(Value=amp_5)
neg_11 = Negative(Value=amp_6)
pt = Point(deplane_4.Origin)
addition_6 = Addition(A=amp_7, B=amp_9)
division_7 = Division(A=ply_thickness, B=2)
addition_7 = Addition(A=amp_7, B=amp_8, C=amp_9)
addition_8 = Addition(A=amp_8, B=amp_7, C=neg_10, D=amp_4, E=neg_11, F=amp_10)
addition_9 = Addition(A=neg_10, B=amp_4, C=neg_11, D=amp_10)
addition_10 = Addition(A=neg_11, B=amp_10)
addition_11 = Addition(A=amp_4, B=neg_11, C=amp_10)
rectangle = Rectangle(Plane=pl_3, XSize=cluster, YSize=cluster_2, Radius=0)  # -> Rectangle, Length
amp_11 = Amplitude(Vector=deplane_4.XAxis, Amplitude=division_7)
move_6 = Move(Geometry=pt, Motion=addition_8)  # -> Geometry, Transform
move_7 = Move(Geometry=pt, Motion=amp_10)  # -> Geometry, Transform
move_8 = Move(Geometry=pt, Motion=amp_7)  # -> Geometry, Transform
move_9 = Move(Geometry=pt, Motion=addition_6)  # -> Geometry, Transform
move_10 = Move(Geometry=pt, Motion=addition_7)  # -> Geometry, Transform
move_11 = Move(Geometry=pt, Motion=addition_9)  # -> Geometry, Transform
move_12 = Move(Geometry=pt, Motion=addition_10)  # -> Geometry, Transform
move_13 = Move(Geometry=pt, Motion=addition_11)  # -> Geometry, Transform
rectangle_2 = Rectangle(Plane=pl_4, XSize=cluster, YSize=cluster_2, Radius=0)  # -> Rectangle, Length
pl_5 = ConstructPlane(Origin=move_10.Geometry, XAxis=deplane_4.XAxis, YAxis=deplane_4.YAxis)
merge_3 = Merge(
    Data1=move_6.Geometry,
    Data2=move_11.Geometry,
    Data3=move_13.Geometry,
    Data4=move_12.Geometry,
    Data5=move_7.Geometry,
    Data6=move_8.Geometry,
    Data7=move_9.Geometry,
    Data8=move_10.Geometry)

pt_2 = Point(move_3.Geometry)
tool_size_2 = Number(addition_5)
item = ListItem(List=pt_2, Index="1", Wrap=True)
cluster_3 = Cluster_11(P=item)
xy_2 = XYPlane(Origin=pt_2)
replace = ReplaceItems(List=xy_2, Item=cluster_3, Indices="1", Wrap=False)  # -> graft(List)
dog_bone_pocket = DogBonePocket(plane=replace, tool_size=tool_size_2)

pln = Plane(pl)
pt_3 = Point(move_2.Geometry)
pln_2 = Plane(pl_2)
tool_size_3 = Number(addition_5)
cluster_4 = Cluster_12(O=pt_3, P=pln)
cluster_5 = Cluster_12(O=pt_3, P=pln_2)
item_2 = ListItem(List=cluster_5, Index="1", Wrap=True)
replace_2 = ReplaceItems(List=cluster_4, Item=item_2, Indices="1", Wrap=False)  # -> graft(List)
dog_bone_pocket_2 = DogBonePocket(plane=replace_2, tool_size=tool_size_3)

pt_4 = Point(move_3.Geometry)
ply_thickness_2 = Number(ply_thickness)
amp_12 = Amplitude(Vector=deplane_2.YAxis, Amplitude=ply_thickness_2)
panel = Panel("""0
-1""")
move_14 = Move(Geometry=pt_4, Motion=amp_12)  # -> Geometry, Transform
item_3 = ListItem(List=pt_4, Index=panel, Wrap=True)
ins = InsertItems(List=move_14.Geometry, Item=item_3, Indices=panel, Wrap=True)

pline = PolyLine(Vertices=merge_3, Closed=False)
move_15 = Move(Geometry=pline, Motion=amp_11)  # -> Geometry, Transform
mirror = Mirror(Geometry=move_15.Geometry, Plane=pl_5)  # -> Geometry, Transform
join = JoinCurves(Curves=[move_15.Geometry, mirror.Geometry], Preserve=False)
pline_2 = PolyLine(Vertices=ins, Closed=False)
pline_3 = PolyLine(Vertices=dog_bone_pocket, Closed=False)  # -> flatten(Polyline)

item_4 = ListItem(List=dog_bone_pocket_2, Index=-1, Wrap=True)
pdecon = Deconstruct(Point=item_4)  # -> XComponent, YComponent, ZComponent
pt_5 = ConstructPoint(XCoordinate=pdecon.XComponent, YCoordinate=pdecon.YComponent, ZCoordinate=0)
ln = Line(StartPoint=pt_5, EndPoint=item_4)

pline_4 = PolyLine(Vertices=dog_bone_pocket_2, Closed=False)  # -> flatten(Polyline)
item_5 = ListItem(List=dog_bone_pocket_2, Index=0, Wrap=True)
trim = TrimTree(Tree=item_5, Depth=1)
join_2 = JoinCurves(Curves=flatten([pline_2, pline_3]), Preserve=False)
pline_5 = PolyLine(Vertices=trim, Closed=False)
crv = Curve(rectangle_2.Rectangle)
join_3 = JoinCurves(Curves=flatten([pline_5, pline_4, ln]), Preserve=False)
flip = FlipCurve(Curve=join_2)  # -> Curve, Flag
crv_2 = Curve(rectangle.Rectangle)
flip_2 = FlipCurve(Curve=join_3)  # -> Curve, Flag
crv_3 = Curve(flatten([flip.Curve, crv_2]))
crv_4 = Curve(flatten(join))
pln_3 = Plane(xy)
crv_5 = Curve(flatten([flip_2.Curve, crv]))
crv_6 = ClusterOutput(crv_3)
crv_7 = ClusterOutput(crv_4)
pln_4 = ClusterOutput(pln_3)
crv_8 = ClusterOutput(crv_5)

# ==== cluster Cluster_15
B = ClusterInput()
O = ClusterInput()
A = ClusterInput()

group = Group(Objects=O)
orient = Orient(Geometry=group, Source=A, Target=B)  # -> Geometry, Transform
match = MatchTree(Tree=orient.Geometry, Guide=B)
ungroup = Ungroup(Group=match)
trim = TrimTree(Tree=ungroup, Depth=1)

T = ClusterOutput(trim)

# ==== cluster ClosedSolidOffset
srf = ClusterInput()
srf_2 = Surface(srf)
evalsrf = EvaluateSurface(Surface=reparameterize(srf_2), Point=Point(0.5, 0.5, 0))  # -> Point, Normal, UDirection, VDirection, Frame
A = ClusterInput()
amp = Amplitude(Vector=evalsrf.Normal, Amplitude=A)
srf_3 = Surface(graft(srf_2))
vec = Vector(graft(amp))
wires = BrepWireframe(Brep=srf_3, Density=-1)
trim = TrimTree(Tree=wires, Depth=1)
join = JoinCurves(Curves=trim, Preserve=False)
extr = Extrude(Base=join, Direction=vec)
move = Move(Geometry=srf_3, Motion=vec)  # -> Geometry, Transform
trim_2 = TrimTree(Tree=extr, Depth=1)
geo = Geometry([move.Geometry, srf_3])
geo_2 = Geometry([trim_2, geo])
trim_3 = TrimTree(Tree=geo_2, Depth=1)
join_2 = BrepJoin(Breps=trim_3)  # -> Breps, Closed
B = ClusterOutput(join_2.Breps)

# ==== cluster TestCurvesAndExcludeOpenAndNonPlanar
crv = ClusterInput()

# ---- group: only works with closed curves
crv_2 = Curve(crv)
cls = Closed(Curve=crv_2)  # -> Closed, Periodic
planar = Planar(Curve=crv_2)  # -> Planar, Plane, Deviation

# ----
and = GateAnd(A=cls.Closed, B=planar.Planar)

# ---- group: only works with closed curves (continued)
cull = CullPattern(List=crv_2, CullPattern=and)

# ----
L = ClusterOutput(cull)

# ==== cluster Cluster_3
crv = ClusterInput()
num = ClusterInput()
crv_2 = Curve(crv)
num_2 = Number(num)
divdist = DivideDistance(Curve=crv_2, Distance=num_2)  # -> Points, Tangents, Parameters
lng = ListLength(List=divdist.Points)
divide = DivideCurve(Curve=crv_2, Count=lng, Kinks=False)  # -> Points, Tangents, Parameters
P = ClusterOutput(divide.Points)
T = ClusterOutput(divide.Tangents)

# ==== cluster Cluster_4
crv = ClusterInput()
num = Number(5)
crv_2 = Curve(crv)
neg = Negative(Value=num)
offset = OffsetCurve(Curve=crv_2, Distance=[num, neg], Plane=PlaneXY(0, 0, 0), Corners=1)
trim = TrimTree(Tree=offset, Depth=1)
len = Length(Curve=trim)
sort = SortList(Keys=len, ValuesA=trim)  # -> Keys, ValuesA
item = ListItem(List=sort.ValuesA, Index=0, Wrap=True)
crv_3 = Curve(item)
crv_4 = ClusterOutput(crv_3)

# ==== cluster Cluster_5
num = ClusterInput()
crv = ClusterInput()
num_2 = Number(num)
crv_2 = Curve(crv)
neg = Negative(Value=num_2)
offset = OffsetCurve(Curve=crv_2, Distance=[num_2, neg], Plane=PlaneXY(0, 0, 0), Corners=1)
trim = TrimTree(Tree=offset, Depth=1)
len = Length(Curve=trim)
sort = SortList(Keys=len, ValuesA=trim)  # -> Keys, ValuesA
item = ListItem(List=sort.ValuesA, Index=0, Wrap=True)
crv_3 = Curve(item)
crv_4 = ClusterOutput(crv_3)

# ==== cluster DogBonePocket
plane = ClusterInput()
tool_size = ClusterInput()
pln = Plane(plane)
tool_size_2 = Number(tool_size)
deplane = DeconstructPlane(Plane=pln)  # -> Origin, XAxis, YAxis, ZAxis
division = Division(A=tool_size_2, B="2")
neg = Negative(Value=division)
pt = Point(deplane.Origin)
amp = Amplitude(Vector=deplane.YAxis, Amplitude=neg)
amp_2 = Amplitude(Vector=deplane.XAxis, Amplitude=tool_size_2)
move = Move(Geometry=graft(pt), Motion=amp)  # -> Geometry, Transform
trim = TrimTree(Tree=move.Geometry, Depth=1)
pt_2 = Point([pt, trim])
move_2 = Move(Geometry=pt_2, Motion=amp_2)  # -> Geometry, Transform
pt_3 = Point([pt_2, move_2.Geometry])
avr = Average(Input=pt_3)
deplane_2 = DeconstructPlane(Plane=pln)  # -> Origin, XAxis, YAxis, ZAxis
vec2pt = Vector2Pt(PointA=avr, PointB=pt_3, Unitize=False)  # -> Vector, Length
angle = Angle(VectorA=vec2pt.Vector, VectorB=deplane_2.YAxis, Plane=pln)  # -> Angle, Reflex
sort = SortList(Keys=angle.Angle, ValuesA=pt_3)  # -> Keys, reverse(ValuesA)
pt_4 = Point(sort.ValuesA)
pt_5 = ClusterOutput(pt_4)

# ==== cluster Cluster_11
P = ClusterInput()
deplane = DeconstructPlane(Plane=P)  # -> Origin, XAxis, YAxis, ZAxis
neg = Negative(Value=deplane.XAxis)
pl = ConstructPlane(Origin=deplane.Origin, XAxis=neg, YAxis=deplane.YAxis)
pl_2 = ClusterOutput(pl)

# ==== cluster Cluster_12
P = ClusterInput()
deplane = DeconstructPlane(Plane=P)  # -> Origin, XAxis, YAxis, ZAxis
O = ClusterInput()
pl = ConstructPlane(Origin=O, XAxis=deplane.XAxis, YAxis=deplane.YAxis)
pl_2 = ClusterOutput(pl)

# ==== cluster Cluster_13
A = ClusterInput()
division = Division(A=A, B=2)
neg = Negative(Value=division)
dom = ConstructDomain(DomainStart=neg, DomainEnd=division)
I = ClusterOutput(dom)
